# Grasshopper definition CS_00_intro.gh (Grasshopper 1.0.7)
# Copyright: Co-de-iT

# Rhino/GH developer docs
# C# scripting component
# https://developer.rhino3d.com/ - Rhino developer home page
# 
# https://developer.rhino3d.com/api/ - API references
# 
# http://developer.rhino3d.com/guides/rhinocommon/what-is-rhinocommon/
# 
# https://developer.rhino3d.com/api/RhinoCommon - RhinoCommon SDK
# 
# https://developer.rhino3d.com/api/grasshopper - Grasshopper SDK
# warning/error messages
# and results of Print() function
# outputs
# inputs
# double-click
# to open editor
# 
# right-click
# for context menu
# and help
# right-click to
# set output name
# 
# zoom in
# to add or remove
# right-click to
# set input name,
# type and structure
# 
# zoom in
# to add or remove
# C# references
# https://msdn.microsoft.com/en-gb/library/67ef8sbd.aspx - C# programming guide
# 
# https://www.rhino3d.com/download/rhino/7/essential-csharp-scripting-grasshopper
# Read the Help for the C# scripting component
please_switch_to_icon_display = CSharpScript()  # -> Out, A
# Reflect()
mesh = Mesh(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)
crv = Curve(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)
# sum of 2 numbers
pt = Point(Point(0, 0, 0))
# create Point
number_slider = Slider(47.361, range=0..100)
# create Polyline/NURBS curve
number_slider_2 = Slider(0, range=0..100)
# CS_00_intro
# 
# C# - intro definition
# 
# code by Alessio Erioli
# 
# v 0.1
# © Co-de-iT 2020 / Creative Commons Attribution-Non Commercial-ShareAlike 4.0 International License
# not Hello World (but sort of)
panel = Panel("<input your name>")
pt_2 = Point([Point(-10.44971177, -16.09633362, 0), Point(-38.18687341, 24.18943046, 0), Point(-4.694320715, 66.12353854, 0), Point(62.94356935, 64.88826719, 0), Point(85.96513356, 6.512157948, 0), Point(67.87676168, -34.18667877, 0)])
data = Data()
just_do_it = CSharpScript(P=pt_2, deg=Slider(3, range=1..5), periodic=Toggle(False))  # -> out, Pl, C; inputs P: list of Point3d, deg: Int32, periodic: Boolean
# ---------- just_do_it: C# ----------
    Pl = new Polyline(P);
    C = NurbsCurve.Create(periodic, deg, P);
# ---------- end just_do_it ----------
an_icon_is_worth_a_1000_words = CSharpScript(A=Slider(25.915, range=0..100), B=Slider(63.292, range=0..100))  # -> out, S; inputs A: Double, B: Double
# ---------- an_icon_is_worth_a_1000_words: C# ----------
    S = A + B;

    Print("The sum of A and B is {0}", A+B);
# ---------- end an_icon_is_worth_a_1000_words ----------
trust_me_you_ll_thank_me_later = CSharpScript(x=number_slider, y=Slider(47.361, range=0..100), z=number_slider_2)  # -> out, A; inputs x: Double, y: Double, z: Double
# ---------- trust_me_you_ll_thank_me_later: C# ----------
    A = new Point3d(x, y, z);
# ---------- end trust_me_you_ll_thank_me_later ----------
seriously_switch_to_icon_display = CSharpScript(x=panel, y="<input your eye colour>")  # -> out, A
# ---------- seriously_switch_to_icon_display: C# ----------
    Print("Hello {0}, 'tis a fine day to learn C#!\n\nWell, {1} eyes, let's get started!", x, y);
# ---------- end seriously_switch_to_icon_display ----------
i_am_begging_you = CSharpScript(x=data)  # -> out, A
# ---------- i_am_begging_you: C# ----------
    Reflect(x);
# ---------- end i_am_begging_you ----------
panel_2 = Panel(seriously_switch_to_icon_display.out)
panel_3 = Panel(i_am_begging_you.out)
panel_4 = Panel(an_icon_is_worth_a_1000_words.out)
panel_5 = Panel(an_icon_is_worth_a_1000_words.S)
pt_3 = Point(trust_me_you_ll_thank_me_later.A)
crv_2 = Curve(just_do_it.Pl)
crv_3 = Curve(just_do_it.C)
# reflect a specific method
pt_4 = Point(Point(0, 0, 0))
c_script = CSharpScript(x=pt_4)  # -> out, A
# ---------- c_script: C# ----------
    Reflect(x, "DistanceTo");
# ---------- end c_script ----------
panel_6 = Panel(c_script.out)
