# Grasshopper definition CS_02_data 02.gh (Grasshopper 1.0.7)
# Copyright: Co-de-iT

# ---- group: while...do loops
c_script = CSharpScript(thres=Slider(0.001, range=0..20))  # -> out, A, B; inputs thres: Double
# ---------- c_script: C# ----------
    double a = 10, b = 10;
    int countA = 0, countB = 0;

    // while is a conditional loop
    // gets executed while the condition is true
    while(a > thres && countA < 1000) // countA < 1000 ensures the loop doesn't go on forever
    {
      a *= 0.5; // faster than a /= 2.0;
      countA++;
    }


    // the do loop is similar to while but it always gets executed at least once
    // since the condition is at the bottom
    do
    {
      b *= 0.5;
      countB++;
    }
    while(b > thres && countB < 1000);

    A = countA;
    B = countB;
# ---------- end c_script ----------

# ---- group: for loop
# loops
c_script_2 = CSharpScript(n=Slider(20, range=1..100), step=Slider(0.5, range=0..5))  # -> out, P; inputs n: Int32, step: Double
# ---------- c_script_2: C# ----------
    List<Point3d> pts = new List<Point3d>();
    
    for(int i = 0; i < n; i++)
    {
      pts.Add(new Point3d(i * step, 0, 0));
    
    }
    
    P = pts;
# ---------- end c_script_2 ----------

# ---- group: nested for loop
c_script_3 = CSharpScript(nX=Slider(20, range=1..100), nY=Slider(20, range=1..100), step=Slider(0.5, range=0..5))  # -> out, P; inputs nX: Int32, nY: Double, step: Double
# ---------- c_script_3: C# ----------
    List<Point3d> pts = new List<Point3d>();

    for(int i = 0; i < nX; i++)
      for(int j=0; j<nY;j++)
    {
      pts.Add(new Point3d(i * step, j*step, 0));

    }

    P = pts;
# ---------- end c_script_3 ----------

# ---- group: conditional statement if
# conditional statements
c_script_4 = CSharpScript(x=Slider(1, range=-5..5))  # -> out, A, B; inputs x: Double
# ---------- c_script_4: C# ----------
    Point3d p = new Point3d(x, 0, 0);

    A = p;
    
    if (x > 0)
    {
      B = true;
    } else
    {
      B = false;
    }
# ---------- end c_script_4 ----------

# ----
panel = Panel(c_script.A)
panel_2 = Panel(c_script.B)
dispatch = Dispatch(List=c_script_4.A, DispatchPattern=c_script_4.B)  # -> ListA, ListB
# CS_02_data 02
# 
# Variables and data structures in C# - flow control statements and data trees
# 
# code by Alessio Erioli
# 
# v 0.1
# © Co-de-iT 2020 / Creative Commons Attribution-Non Commercial-ShareAlike 4.0 International License
pt = Point(c_script_2.P)
pt_2 = Point(c_script_3.P)
sph = Sphere(Base=dispatch.ListA, Radius=1)
box = CenterBox(Base=dispatch.ListB, X=1, Y=1, Z=1)
brep = Brep([sph, box])

# ---- group: foreach loop
c_script_5 = CSharpScript(P=pt_2, r=Slider(0.169, range=0..5))  # -> out, C; inputs P: list of Point3d, r: Double
# ---------- c_script_5: C# ----------
    List<Circle> circs = new List<Circle>();
    
    foreach(Point3d p in P)
    {
      circs.Add(new Circle(p, r));
    }
    
    C = circs;
# ---------- end c_script_5 ----------

# ----
circle = Circle(c_script_5.C)
# using loops and conditions
number_slider = Slider(20, range=1..100)
pt_3 = Point(Point(3.755555907, 4.300968111, 0))
map = BooleanToggle(False)

# ---- group: attractor point
c_script_6 = CSharpScript(
    nX=number_slider,
    nY=Slider(20, range=1..100),
    step=Slider(0.5, range=0..5),
    att=pt_3,
    rA=Slider(0.25, range=0..5),
    rB=Slider(0.05, range=0..5),
    thres=Slider(2.5, range=0..20),
    map=map)  # -> out, C; inputs nX: Int32, nY: Double, step: Double, att: Point3d, rA: Double, rB: Double, thres: Double, map: Boolean
# ---------- c_script_6: C# ----------
    List<Circle> circs = new List<Circle>();
    double d, r;
    double invThres = 1 / thres;
    Point3d p;


    for(int i = 0; i < nX; i++)
      for(int j = 0; j < nY;j++)
      {
        p = new Point3d(i * step, j * step, 0);
        d = att.DistanceTo(p);

        if (d < thres)
        {
          if (map)
            r = rB + (rB - rA) * (d - thres) * invThres; // mapping formula: when d-->thres r=rB, when d-->0 r = rA
          else r = rA;

        }
        else r = rB;

        circs.Add(new Circle(p, r));

      }

    C = circs;
# ---------- end c_script_6 ----------

# ----
circle_2 = Circle(c_script_6.C)
darc = DeconstructArc(Arc=circle_2)  # -> BasePlane, Radius, Angle
bnd = Bounds(Numbers=darc.Radius)
dedomain = DeconstructDomain(Domain=bnd)  # -> Start, End
gradient = Gradient(
    LowerLimit=dedomain.Start,
    UpperLimit=dedomain.End,
    Parameter=darc.Radius,
    stops=[0: RGB(0, 128, 0), 0.5: RGB(255, 255, 0), 1: RGB(255, 0, 0)])
preview = CustomPreview(Geometry=circle_2, Material=gradient)
# A, B, C - building data trees
# 
# D, E, F, G - extracting data from data trees
c_script_7 = CSharpScript()  # -> out, A, B, C, port, D, E, F, G
# ---------- c_script_7: C# ----------
    // declare a DataTree
    DataTree <Point3d> dT = new DataTree<Point3d>();

    // add data to a DataTree
    for (int i = 0; i < 10; i++)
    {
      Point3d pt = new Point3d(i, 0, 0);

      // Adding data to a DataTree requires a path.
      // In this case the path will have a single branch index.
      // There will be only one Point associated with each path
      GH_Path Path = new GH_Path(0, i);

      // adding single elements to the DataTree
      dT.Add(pt, Path);
    }

    A = dT;

    // ..........................................................................................................

    DataTree <Point3d> dT1 = new DataTree<Point3d>();
    // in case there is no path specified, data is stored in default branch {0}
    dT1.Add(new Point3d(0.0, 1.0, 0));

    // any overload that accepts args allows us to declare a row of comma separated values
    // such as ---> new GH_Path(Int32[] args)
    GH_Path myPath = new GH_Path(1, 2, 3);

    dT1.Add(new Point3d(1.0, 1.0, 0), myPath);

    int[] pNums = {1,2,4};
    myPath = new GH_Path(pNums);

    dT1.Add(new Point3d(2.0, 1.0, 0), myPath);


    B = dT1;

    // ..........................................................................................................

    DataTree <Point3d> dT2 = new DataTree<Point3d>();

    // add data to the DataTree
    for (int i = 0; i < 10; i++)
      for(int j = 0; j < 10; j++)
        for(int k = 0; k < 10; k++)
        {
          Point3d pt = new Point3d(i, j + 2.0, k);


          // this time the path will have 2 dimensions: rows and columns
          GH_Path Path = new GH_Path(0, i, j);

          // adding single elements to the DataTree
          dT2.Add(pt, Path);
        }


    C = dT2;

    // retrieving a branch
    //
    // data in DataTrees can be retried with the following syntaxes
    // DataTree.Branch(path)
    // DataTree.Branch([]args)
    // DataTree.Branch(sequential branch index)
    D = dT2.Branch(0, 2, 3);

    // retrieving an element
    // same syntax as above, add element index between []
    E = dT2.Branch(0, 2, 3)[3];

    // branch count and list count
    F = dT2.BranchCount;     // or dT2.Branches.Count;
    G = dT2.Branch(0, 2, 3).Count;
# ---------- end c_script_7 ----------
pt_4 = Point(c_script_7.B)
# data tree operations
# (graft, flatten, simplify, other)
c_script_8 = CSharpScript(P=c_script_7.C)  # -> out, A, B, C, D, E; inputs P: tree of Point3d
# ---------- c_script_8: C# usings ----------
using System.IO;
using System.Linq;
using System.Data;
using System.Drawing;
using System.Reflection;
using System.Windows.Forms;
using System.Xml;
using System.Xml.Linq;
using System.Runtime.InteropServices;

using Rhino.DocObjects;
using Rhino.Collections;
using GH_IO;
using GH_IO.Serialization;
# ---------- c_script_8: C# ----------
    // simplify
    P.SimplifyPaths();
    // making a copy since DataTree is reference type
    A = new DataTree<Point3d>(P);

    // graft
    P.Graft(false);
    B = new DataTree<Point3d>(P);

    // flatten (extract alla data to a list)
    List<Point3d> pts = P.AllData(); // data tree to List
    C = pts;

    // extract paths list (like Param Viewer)
    IList<GH_Path> paths = P.Paths;
    D = paths;

    // rebuild a tree from the list
    DataTree <Point3d> pTree = new DataTree<Point3d>();
    GH_Path p;

    for (int i = 0; i < paths.Count; i++){
      p = new GH_Path(paths[i][0]);
      pTree.Add(pts[i], p);
    }
    E = pTree;
# ---------- end c_script_8 ----------
panel_3 = Panel(c_script_7.C)
panel_4 = Panel(c_script_7.G)
# data trees
panel_5 = Panel(c_script_7.A)
panel_6 = Panel(c_script_7.B)
pt_5 = Point(c_script_7.D)
pt_6 = Point(c_script_7.E)
panel_7 = Panel(c_script_7.F)
simplify = Panel(c_script_8.A)
graft = Panel(c_script_8.B)
flatten = Panel(c_script_8.C)
tree_paths = Panel(c_script_8.D)
rebuilt_tree = Panel(c_script_8.E)
viewer = ParamViewer(panel_5)
viewer_2 = ParamViewer(panel_6)
viewer_3 = ParamViewer(panel_3)
pline = PolyLine(Vertices=pt_5, Closed=False)
sph_2 = Sphere(Base=pt_6, Radius=0.25)
preview_2 = CustomPreview(Geometry=pline, Material=ColourSwatch(SwatchColor=RGB(227, 145, 145)))
preview_3 = CustomPreview(Geometry=sph_2, Material=ColourSwatch(SwatchColor=RGB(255, 255, 255)))
preview_4 = CustomPreview(Geometry=c_script_7.C, Material=ColourSwatch(SwatchColor=RGB(51, 51, 51)))
