# Grasshopper definition CS_03_functions.gh (Grasshopper 1.0.7)
# Copyright: Co-de-iT

# functions from external assemblies
sqgrid = Square(
    Plane=PlaneXY(0, 0, 0),
    Size=Slider(0.25, range=0..1),
    ExtentX=Slider(58, range=1..100),
    ExtentY=Slider(66, range=1..100))  # -> Cells, Points
scale = Slider(0.193, range=0..1)
# functions
c_script = CSharpScript(ang=Slider(1, range=0..6.283), rad=Slider(5, range=0..10))  # -> out, A; inputs ang: Double, rad: Double
# ---------- c_script: C# ----------
    A = PtOnCircle(ang, rad);
# ---------- c_script: C# additional code ----------
  // functions must have a return type - this one returns a Point3d
  public Point3d PtOnCircle(double ang, double radius)
  {
    Point3d pt = new Point3d();

    pt = new Point3d(Math.Cos(ang) * radius, Math.Sin(ang) * radius, 0);

    // functions can be called by other functions
    PtData(pt, 3);

    return pt;
  }


  // functions that do not return data must be declared as void
  public void PtData(Point3d p, int digits)
  {
    Print("Point at\nX: {0}\nY: {1}", Math.Round(p.X, digits), Math.Round(p.Y, digits));
  }
# ---------- end c_script ----------
c_script_2 = CSharpScript(n=Slider(200, range=3..200), phX=Slider(6.193, range=0..10), phY=Slider(14.297, range=0..20))  # -> out, A; inputs n: Int32, phX: Double, phY: Double
# ---------- c_script_2: C# ----------
    A = Lissajous(n, phX, phY);
# ---------- c_script_2: C# additional code ----------
  List<Point3d> Lissajous(int n, double phX, double phY)
  {
    List<Point3d> pts = new List<Point3d>();
    double radius = 5.0;

    double step = Math.PI * 2 / (double) n;

    for (int i = 0; i < n; i++)
      pts.Add(new Point3d(Math.Cos(i * step * phX) * radius, Math.Sin(i * step * phY) * radius, 0));

    return pts;
  }
# ---------- end c_script_2 ----------
c_script_3 = CSharpScript(n=Slider(3, range=3..50), rad=Slider(5, range=0..10))  # -> out, A; inputs n: Int32, rad: Double
# ---------- c_script_3: C# ----------
    A = PtsOnCircle(n, rad);
# ---------- c_script_3: C# additional code ----------
  List<Point3d> PtsOnCircle(int n, double radius)
  {
    List<Point3d> pts = new List<Point3d>();
    
    double step = Math.PI * 2 / (double) n;
    
    for (int i = 0; i < n; i++)
      pts.Add(new Point3d(Math.Cos(i * step) * radius, Math.Sin(i * step) * radius, 0));

    return pts;
  }
# ---------- end c_script_3 ----------
# CS_03_functions
# 
# Functions
# 
# code by Alessio Erioli
# 
# v 0.1
# © Co-de-iT 2020 / Creative Commons Attribution-Non Commercial-ShareAlike 4.0 International License
panel = Panel(c_script.out)
pline = PolyLine(Vertices=c_script_3.A, Closed=True)

# ---- group: Simplex Noise
# Add The Missing Referenced Assembly: right click on the component icon > Manage Assemblies
# 
# In the left panel (Referenced Assemblies), click on Add, then look for Noises.dll
# 
# Uncomment the single line comments in the using statement and the RunScript function inside the component
c_script_4 = CSharpScript(P=sqgrid.Points, S=scale, t=Slider(0, range=0..1))  # -> out, A; inputs P: Point3d, S: Double, t: Double
# ---------- c_script_4: C# usings ----------
// using Noises;
# ---------- c_script_4: C# ----------
            /*
  right click on the component icon > Manage Assemblies

In the left panel (Referenced Assemblies), click on Add, then look for Noises.dll

Uncomment the single line comments in the using statement and the RunScript function

  */

    //    Noise noise = new Noise();
    P *= S;
    P.Z += t;
    // A = Noise.Generate((float) P.X, (float) P.Y, (float) P.Z);
# ---------- end c_script_4 ----------

# ----
pline_2 = PolyLine(Vertices=c_script_2.A, Closed=False)
Z = UnitZ(Factor=c_script_4.A)
pt = Point(Point(0, 0, 0))
vec = Vector(c_script.A)
panel_2 = Panel(c_script_4.out)
move = Move(Geometry=sqgrid.Points, Motion=Z)  # -> Geometry, Transform
vdisex = VectorDisplayEx(Point=pt, Vector=vec, Colour=RGB(0, 0, 0), Width=2)
