# Grasshopper definition CS_04_1_Langton's ant.gh (Grasshopper 1.0.7)
# Copyright: Co-de-iT

iterations = Slider(200, range=1..1000)
reset = Button()
go = BooleanToggle(False)
# Langton's Ant
# 
# An ant goes for a walk....
#    . At a white square, turn 90° right, flip the color of the square, move forward one unit
#    . At a black square, turn 90° left, flip the color of the square, move forward one unit
# 
# code by Alessio Erioli
# 
# v 0.1
# © Co-de-iT 2020 / Creative Commons Attribution-Non Commercial-ShareAlike 4.0 International License
c_script = CSharpScript(go=go, reset=reset, it=iterations, size="100")  # -> out, D; inputs go: Boolean, reset: Boolean, it: Int32, size: Int32
# ---------- c_script: C# usings ----------
using System.Linq;
using System.Threading.Tasks;
using System.Drawing;
# ---------- c_script: C# ----------
                /*
  Langton's Ant:

   . At a white square, turn 90° right, flip the color of the square, move forward one unit
   . At a black square, turn 90° left, flip the color of the square, move forward one unit

  */
    if (reset || antSim == null || antSim.size != size)
    {
      antSim = new LangAnt(size);
    }

    if (go)
    {
      for(int i = 0; i < it; i++)
        antSim.Update();
      Component.ExpireSolution(true);
    }

    D = antSim.GetData();
# ---------- c_script: C# additional code ----------
  LangAnt antSim;

  class LangAnt
  {
    public int[][] data;
    public int[] pos;
    public int[] vel;
    public int size;
    public LangAnt(int size)
    {
      this.size = size;
      data = InitializeData(size);
      pos = new int[]{(int) Math.Floor(size * 0.5),(int) Math.Floor(size * 0.5)};
      vel = new int[]{1,0}; // x,y
    }

    public int[][] InitializeData(int size)
    {
      int[][] data = new int[size][];

      for(int i = 0; i < data.Length; i++)
        data[i] = Enumerable.Repeat(1, size).ToArray();

      return data;

    }

    public void Update()
    {
      int z = vel[0];

      // At a white square, turn 90° right
      if(data[pos[0]][pos[1]] == 1)
      {
        // turn 90 ° right
        vel[0] = vel[1];
        vel[1] = -z;
      }
      else
        // At a black square, turn 90° left
      {
        // turn 90° left
        vel[0] = -vel[1];
        vel[1] = z;
      }

      // flip square color
      data[pos[0]][pos[1]] = Math.Abs(data[pos[0]][pos[1]] - 1);

      // move forward one unit
      pos[0] += vel[0];
      pos[1] += vel[1];

      // check containment
      pos[0] = (pos[0] + size) % size;
      pos[1] = (pos[1] + size) % size;
    }


    public GH_Integer[] GetData()
    {

      return ToArray(data);
    }


    public DataTree<GH_Integer> ToDataTree(int[][] array)
    {
      DataTree<GH_Integer> dT = new DataTree<GH_Integer>();

      for(int i = 0; i < array.Length; i++)
        dT.AddRange(array[i].Select(x => new GH_Integer(x)), new GH_Path(i));

      return dT;
    }

    public GH_Integer[] ToArray(int[][] array)
    {
      GH_Integer[] rA = new GH_Integer[array.Length * array[0].Length];
      Parallel.For(0, array.Length, i =>
        {
        for(int j = 0; j < array[i].Length; j++)
          rA[i * array[i].Length + j] = new GH_Integer(array[i][j]);

        });
      return rA;
    }
  }
# ---------- end c_script ----------
multiplication = Multiplication(A="100", B=Slider(20, range=1..50))
cdom = CenteredDomain(n=multiplication)  # -> D; inputs n: Double
# ---------- cdom: C# ----------
    D = new Interval(-n * 0.5, n * 0.5);
# ---------- end cdom ----------
subtraction = Subtraction(A="100", B="1")
rectangle = Rectangle(Plane=PlaneXY(0, 0, 0), XSize=cdom, YSize=cdom, Radius=0)  # -> Rectangle, Length
mplane = MeshPlane(Boundary=rectangle.Rectangle, WidthCount=subtraction, HeightCount=subtraction)  # -> Mesh, Area
mcol = MeshColours(Mesh=mplane.Mesh, Colours=ColourSwatch(SwatchColor=RGB(255, 255, 255)))
c_script_2 = CSharpScript(D=c_script.D, M=mcol)  # -> Mc; inputs D: list, M: Mesh
# ---------- c_script_2: C# usings ----------
using System.Threading.Tasks;
using System.Drawing;
using System.Linq;
# ---------- c_script_2: C# ----------
    if(D.Count != M.Vertices.Count) return;

    // cast input list to an int array (faster access)
    int[] D1 = D.Select(x => (int) x).ToArray();

    Parallel.For(0, M.Vertices.Count, i =>
      {
      M.VertexColors[i] = cols[D1[i]];
      }
      );

    Mc = new GH_Mesh(M);
# ---------- c_script_2: C# additional code ----------
  public  Dictionary<int, Color> cols = new Dictionary<int,Color>(){{0,Color.Black},{1,Color.White}};
# ---------- end c_script_2 ----------
