# Grasshopper definition CS_05_0_gradient descent.gh (Grasshopper 1.0.7)
# Copyright: Co-de-iT

mesh_type = ValueList({"simple": 0, "complex": 1}, selected="complex")
number_slider = Slider(30, range=2..100)
srf = Surface(reparameterize(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))
mesh_uv = MeshSurface(Surface=srf, UCount=number_slider, VCount=number_slider, Overhang=True, Equalize=False)
mesh = Mesh(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)

# ---- group: move this point around to see vectors change
pt = Point(Point(0, 0, 0))

# ----
filter = StreamFilter(Gate=mesh_type, Stream0=mesh_uv, Stream1=mesh)

# ---- group: BONUS - custom material creator
# This component allows custom material creation (without textures).
# 
# These settings equal the Black Opaque Plastic material.
toggle = BooleanToggle(True)
swatch = ColourSwatch(SwatchColor=RGB(0, 0, 0))
material = MaterialShiny(
    Color_Diffuse=swatch,
    Color_Ambient=swatch,
    Color_Emission=swatch,
    Color_Reflection=ColourSwatch(SwatchColor=RGB(255, 255, 255)),
    Reflectivity="1",
    ReflectionGlossiness="0.15",
    RefractionGlossiness="0.85",
    FresnelReflections=toggle,
    IoR="1.5",
    Transparency="0")  # -> Mat; inputs Color_Diffuse: Color, Color_Ambient: Color, Color_Emission: Color, Color_Reflection: Color, Reflectivity: Double, ReflectionGlossiness: Double, RefractionGlossiness: Double, FresnelReflections: Boolean, IoR: Double, Transparency: Double
# ---------- material: C# usings ----------
using System.Drawing;
# ---------- material: C# ----------
                    /*
  Original code: David Rutten
  extended by Joseph Oster
  further expanded by Alessio Erioli
  see discussion at: https://discourse.mcneel.com/t/custom-preview-shinyness-when-using-create-material-bug/53513/8
  */

    Reflectivity = Math.Min(Math.Max(Reflectivity, 0), 1);
    ReflectionGlossiness = Math.Min(Math.Max(ReflectionGlossiness, 0), 1);
    Transparency = Math.Min(Math.Max(Transparency, 0), 1);
    Color_Reflection = Color_Reflection.IsEmpty ? Color_Diffuse : Color_Reflection;

    Rhino.DocObjects.Material material = new  Rhino.DocObjects.Material();
    //material.SetBitmapTexture(fileName);
    material.FresnelReflections = FresnelReflections;
    if (FresnelReflections)
      material.FresnelIndexOfRefraction = IoR;
    else material.IndexOfRefraction = IoR;
    material.DiffuseColor = Color_Diffuse;
    material.AmbientColor = Color_Ambient;
    material.EmissionColor = Color_Emission;
    material.ReflectionColor = Color_Reflection;
    material.Reflectivity = Reflectivity;
    material.RefractionGlossiness = RefractionGlossiness;
    material.ReflectionGlossiness = ReflectionGlossiness;
    material.Transparency = Transparency;

    var renderMaterial = Rhino.Render.RenderMaterial.CreateBasicMaterial(material, doc);
    Mat = new GH_Material(renderMaterial);
# ---------- end material ----------

# ----
mesh_2 = Mesh(filter)
mesh_3 = Mesh(mesh_2)
mesh_4 = Mesh(mesh_2)
go = Button()
reset = Button()

# ---- group: point at iteration i (on mesh)
# CS_05_gradient descent
# 
# gradient descent algorithm
# 
# code by Alessio Erioli
# 
# v 0.1
# © Co-de-iT 2020 / Creative Commons Attribution-Non Commercial-ShareAlike 4.0 International License
meshcp = MeshClosestPoint(Point=pt, Mesh=mesh_2)  # -> Point, Index, Parameter

# ----
reset_2 = Button()
go_2 = Button()
trt = TheRealToggle(t=go)  # -> T; inputs t: Boolean
# ---------- trt: C# ----------
    InitComp();

    if(t) r = !r;

    Component.Message = r.ToString();

    T = r;
# ---------- trt: C# additional code ----------
  bool r = false;
  public void InitComp()
  {
    Component.Name = "The Real Toggle";
    Component.NickName = "TRT";
    Component.Description = "Permanent toggle - use a button to change boolean value.\nJust because I hate double clicks.";
  }
# ---------- end trt ----------
# gradient descent - final code
popgeo = PopulateGeometry(Geometry=mesh_3, Count=Slider(1000, range=2..2000), Seed=1)

# ---- group: evaluate mesh normal
# gradient descent (intuition)
meval = MeshEval(Mesh=mesh_2, Parameter=meshcp.Parameter)  # -> Point, Normal, Colour

# ----
trt_2 = TheRealToggle(t=go_2)  # -> T; inputs t: Boolean; same code as trt
# gradient descent - code begin
popgeo_2 = PopulateGeometry(Geometry=mesh_4, Count=Slider(80, range=2..100), Seed=1)

demesh = DeconstructMesh(Mesh=mesh_2)  # -> Vertices, Faces, Colours, Normals
Z = UnitZ(Factor=1)
xprod = CrossProduct(VectorA=demesh.Normals, VectorB=Z, Unitize=False)  # -> Vector, Length
vrot = Rotate(Vector=xprod.Vector, Axis=demesh.Normals, Angle="Pi*0.5")
cluster = Cluster(V=vrot)
vdisex = VectorDisplayEx(Point=demesh.Vertices, Vector=vrot, Colour=cluster, Width=2)

preview = CustomPreview(Geometry=mesh_3, Material=material)

# ---- group: gradient descent code begin
c_script = CSharpScript(P=popgeo_2, M=mesh_4, step=Slider(0.153, range=0..3), reset=reset_2, go=trt_2)  # -> out, Pos, status, Trails; inputs P: list of Point3d, M: Mesh, step: Double, reset: Boolean, go: Boolean
# ---------- c_script: C# ----------
    if (reset || GD == null) GD = new GradientDescent(M, P);

    if (go)
    {

      // update live variables


      // update System


      // expiring solution forces the component to update
      Component.ExpireSolution(true);
    }

    // extracts positions and trails

    Pos = pts;
    status = pStat;
    Trails = trs;
# ---------- c_script: C# additional code ----------
  // persistent variables
  public GradientDescent GD;

  Point3d[] pts;
  Polyline[] trs;
  bool[] pStat;


  // simulation class
  public class GradientDescent
  {
    //fields

    // constructor
    public GradientDescent(Mesh M, List<Point3d> P)
    {

    }

    // methods
    public void Update()
    {

    }


  }


  // Particle class

  public class Particle // in this case public is unnecessary but in the general case it is
  {

    // fields


    // constructor (public if we use it from RunScript)
    public Particle(GradientDescent GraDesc, Point3d pos){

    }

    // methods

    public void update()
    {

    }

    void calcVel()
    {

    }


    void move()
    {

    }

  }
# ---------- end c_script ----------

# ---- group: gradient descent
c_script_2 = CSharpScript(P=popgeo, M=mesh_3, step=Slider(0.2, range=0..3), reset=reset, go=trt)  # -> out, Pos, status, Trails; inputs P: list of Point3d, M: Mesh, step: Double, reset: Boolean, go: Boolean
# ---------- c_script_2: C# usings ----------
using System.Threading.Tasks;
# ---------- c_script_2: C# ----------
    if (reset || GD == null || P.Count != GD.parts.Count) GD = new GradientDescent(M, P);

    if (go)
    {

      // update live variables
      GD.MaxSpeed = step;


      // update System
      GD.Update();
      //GD.UpdatePar(); // try using this one instead of the Update and see what changes


      // expiring solution forces the component to update
      Component.ExpireSolution(true);
    }

    // extracts positions and trails
    pts = new Point3d[P.Count];
    trs = new Polyline[P.Count];
    pStat = new bool[P.Count];
    for(int i = 0; i < GD.parts.Count; i++)
    {
      pts[i] = GD.parts[i].pos;
      if(GD.parts[i].trail.IsValid)trs[i] = GD.parts[i].trail;
      else trs[i] = null;
      pStat[i] = GD.parts[i].alive;
    }

    Pos = pts;
    status = pStat;
    Trails = trs;
# ---------- c_script_2: C# additional code ----------
  // persistent variables
  public GradientDescent GD;

  Point3d[] pts;
  Polyline[] trs;
  bool[] pStat;


  // simulation class
  public class GradientDescent
  {
    public List<Particle> parts;
    public Mesh M;
    public double MaxSpeed;

    public GradientDescent(Mesh M, List<Point3d> P)
    {
      this.M = M;
      parts = new List<Particle>();
      foreach(Point3d p in P) parts.Add(new Particle(this, p));
    }

    public void Update()
    {
      foreach(Particle pa in parts)
        pa.update();
    }

    // update (multithreading)
    public void UpdatePar()
    {
      Parallel.ForEach(parts, pa => {pa.update();});
    }

  }


  // Particle class

  public class Particle // in this case public is unnecessary but in the general case it is
  {

    // fields
    public Point3d pos;
    public Vector3d vel;
    public Polyline trail;
    public bool alive;
    public GradientDescent GraDesc;


    // constructor (public if we use it from RunScript)
    public Particle(GradientDescent GraDesc, Point3d pos){
      this.GraDesc = GraDesc;
      this.pos = pos;
      vel = Vector3d.Zero;
      trail = new Polyline();
      trail.Add(new Point3d(pos));

      alive = true;
    }

    // methods

    public void update()
    {
      calcVel();
      move();
    }

    void calcVel()
    {
      // get closest point to the Mesh
      MeshPoint mP = GraDesc.M.ClosestMeshPoint(pos, 0.0);
      // evaluate Mesh normal at that point
      Vector3d mN = GraDesc.M.NormalAt(mP);
      // find tangent to mesh (perpendicular vector to normal)
      vel = Vector3d.CrossProduct(mN, Vector3d.ZAxis);
      // rotate 90 degrees
      vel.Rotate(Math.PI * 0.5, mN);
      // unitize
      vel.Unitize();
      // set to max speed (step)
      vel *= GraDesc.MaxSpeed;
    }


    void move()
    {
      // calculates new position
      Point3d newPos = pos + vel;
      newPos = GraDesc.M.ClosestPoint(newPos);

      // kills particle if it has reached a pit - update if not
      if (Math.Abs(newPos.Z - pos.Z) < 0.01) alive = false;
      else
      {
        pos = newPos;
        trail.Add(pos);
      }
    }

  }
# ---------- end c_script_2 ----------

# ---- group: find slope vector
Z_2 = UnitZ(Factor=1)
xprod_2 = CrossProduct(VectorA=meval.Normal, VectorB=Z_2, Unitize=True)  # -> Vector, Length
vrot_2 = Rotate(Vector=xprod_2.Vector, Axis=Z_2, Angle="Pi*0.5")

# ----
step = Slider(0.25, range=0..1)
crv = Curve(c_script_2.Trails)
cir = Circle(Plane=c_script.Pos, Radius=0.25)
crv_2 = Curve(c_script.Trails)
M = Material({diffuse=RGB(221, 160, 221), emission=RGB(66, 48, 66), shine=0.5, specular=RGB(255, 255, 255), transparency=0})
cir_2 = Circle(Plane=c_script_2.Pos, Radius=0.25)
weave = Weave(Pattern=graft(c_script_2.status), Stream0=ColourSwatch(SwatchColor=RGB(0, 0, 0)), Stream1=M, NullGaps=False)  # -> flatten(Weave)
gate = StreamGate(Stream=crv, Gate=trt)  # -> Target0, Target1
preview_2 = CustomPreview(
    Geometry=cir,
    Material={diffuse=RGB(221, 160, 221), emission=RGB(66, 48, 66), shine=0.5, specular=RGB(255, 255, 255), transparency=0})
preview_3 = CustomPreview(Geometry=crv_2, Material=ColourSwatch(SwatchColor=RGB(209, 209, 209)))

# ---- group: set step distance
amp = Amplitude(Vector=vrot_2, Amplitude=step)

# ---- group: vector display
mesh_normal = ColourSwatch(SwatchColor=RGB(255, 0, 0))
vdisex_2 = VectorDisplayEx(Point=meshcp.Point, Vector=meval.Normal, Colour=mesh_normal, Width=2)
mesh_tangent = ColourSwatch(SwatchColor=RGB(0, 255, 47))
vdisex_3 = VectorDisplayEx(Point=meshcp.Point, Vector=xprod_2.Vector, Colour=mesh_tangent, Width=2)
mesh_slope = ColourSwatch(SwatchColor=RGB(0, 208, 255))
vdisex_4 = VectorDisplayEx(Point=meshcp.Point, Vector=vrot_2, Colour=mesh_slope, Width=2)
point_movement = ColourSwatch(SwatchColor=RGB(255, 255, 255))
vdisex_5 = VectorDisplayEx(Point=meshcp.Point, Vector=amp, Colour=point_movement, Width="3")

# ----
panel = Panel(""".5
.3""")
preview_4 = CustomPreview(Geometry=cir_2, Material=weave)
dash = DashPattern(Curve=gate.Target0, Pattern=panel)  # -> Dashes, Gaps
move = Move(Geometry=meshcp.Point, Motion=amp)  # -> Geometry, Transform
panel_2 = Panel("custom preview curves")
meshcp_2 = MeshClosestPoint(Point=move.Geometry, Mesh=mesh_2)  # -> Point, Index, Parameter
preview_5 = CustomPreview(Geometry=gate.Target1, Material=ColourSwatch(SwatchColor=RGB(209, 209, 209)))
c_script_3 = CSharpScript(C=dash.Dashes, col=ColourSwatch(SwatchColor=RGB(255, 149, 0)), W="1")  # inputs C: list of Curve, col: Color, W: Int32
# ---------- c_script_3: C# ----------
 
    foreach(Curve cur in C)
    {
      _clip = BoundingBox.Union(_clip, cur.GetBoundingBox(false));
      _curve.Add(cur);
      _color.Add(col);
      _width.Add(W);
    }
# ---------- c_script_3: C# additional code ----------
  private BoundingBox _clip;
  private List<Curve> _curve = new  List<Curve>();
  private List<Color> _color = new  List<Color>();
  private List<int> _width = new  List<int>();

  /// <summary>
  /// This method will be called once every solution, before any calls to RunScript.
  /// </summary>
  public override void BeforeRunScript()
  {
    _clip = BoundingBox.Empty;
    _curve.Clear();
    _color.Clear();
    _width.Clear();
  }
  /// <summary>
  /// This method will be called once every solution, after any calls to RunScript.
  /// </summary>
  public override void AfterRunScript()
  { }


  //Return a BoundingBox that contains all the geometry you are about to draw.
  public override BoundingBox ClippingBox
  {
    get {  return _clip;}
  }

  //Draw all meshes in this method.
  public override void DrawViewportMeshes(IGH_PreviewArgs args)
  {
  }

  //Draw all wires and points in this method.
  public override void DrawViewportWires(IGH_PreviewArgs args)
  {
    for(int i = 0; i < _curve.Count; i++)
      args.Display.DrawCurve(_curve[i], _color[i], _width[i]);
  }
# ---------- end c_script_3 ----------

# ---- group: point at iteration i+1
pt_2 = Point(meshcp_2.Point)

# ==== cluster Cluster
V = ClusterInput()
vlen = VectorLength(Vector=V)
num = Number(vlen)
bnd = Bounds(Numbers=flatten(num))
dom = ConstructDomain(DomainStart=0, DomainEnd=1)
remap = RemapNumbers(Value=num, Source=bnd, Target=dom)  # -> Mapped, Clipped
gradient = Gradient(LowerLimit=0, UpperLimit=1, Parameter=remap.Mapped, stops=[0.206: RGB(143, 143, 143), 1: RGB(0, 0, 0)])
C = ClusterOutput(gradient)
