# Grasshopper definition CS_06_delegates + lambda expression.gh (Grasshopper 1.0.7)
# Copyright: Co-de-iT

# Lambda expression (anonymous function)
# delegates
# parameter
# s  =>  { return s*2; }
# lambda operator
number_slider = Slider(1, range=0..2)
# function body
# (a,b)  => { return a+b; }
# Lambda expression allows the creation of anonymous functions (functions without signature, to be implemented and executed on the fly).
# 
# Example:
# 
# int Sum (int a, int b)
# {
#   return a+b;
# }
# 
# becomes:
# 
# (a,b) => {return a+b;}
# 
# The function body can also have multiple lines and complex instructions.
number_slider_2 = Slider(2, range=0..2)
# What are delegates and what do they do?
# 
# Double click on the C# component and find out!
c_script = CSharpScript(x=number_slider, y=number_slider_2)  # -> out, A; inputs x: Double, y: Double
# ---------- c_script: C# ----------
    // dealing with delegates - or how to pass functions as parameters to other functions

    // ----> start from the Custom additional code below

    // continue from here when done:

    // the Foo function can be called passing as parameter directly the name of
    // any function compatible with the delegate signature:
    Foo(ComputeAverage, x, y); // this will pass the ComputeAverage function as parameter
    Foo(ComputeSquaredSum, x, y); // this will pass the ComputeSquaredSum function as parameter

    // another option is to define instances of BynaryOperator (remember, it's a data type)
    BinaryOperator myFavoriteBinaryOperator = ComputeAverage;
    BinaryOperator yourFavoriteBinaryOperator = ComputeSquaredSum;
    // ... and then pass these to the Foo funciton as parameters
    Foo(myFavoriteBinaryOperator, x, y);
    Foo(yourFavoriteBinaryOperator, x, y);

    // I can also use an anonymous function as a parameter for the delegate
    // provided that it is compatible with the delegate signature:
    Foo((a, b) => {return a + b;}, x, y);
    // C# automatically assumes that a,b are doubles but the function body
    // will have to return a double as well
    // see explanation on labda expression and anonymous functions in this
    // GH definition
# ---------- c_script: C# additional code ----------
  /*

  a delegate is a data type that allows me to pass functions as variables,
  a delegate defines a new data type that represents any function that
  has a matching signature with the delegate

  Let's see an example of delegate declaration:

  delegate <type> <name>(<parameters>);

  */

  delegate double BinaryOperator(double a, double b);

  /*
   BinaryOperator is now a new data type.
   Just as with classes, first I declare my delegate as a new data type,
   but if I need one I have to declare an instance, like:

 BynaryOperator myOp;

 now myOp can be any function that has the same signature of the delegate
 (in this case, one that accepts 2 doubles as parameters and returns a double)

 Here are 2 functions whose signature match the delegate BinaryOperator:
 */

  double ComputeAverage (double first, double second)
  {
    return (first + second) * 0.5;
  }

  double ComputeSquaredSum(double m, double n)
  {
    return (m + n) * (m + n);
  }


  // Finally, here's a function that has the delegate as a parameter:
  void Foo(BinaryOperator bOperator, double a, double b)
  {
    // this will store the result of the function that will be passed as delegate
    double result = bOperator(a, b);
    // and then print it
    Print(result.ToString());
  }
# ---------- end c_script ----------
# CS_06_delegates + lambda expression
# 
# using delegates - a practical example + lambda expression
# 
# code by Alessio Erioli - from an example by Long Nguyen
# 
# v 0.1
# © Co-de-iT 2020 / Creative Commons Attribution-Non Commercial-ShareAlike 4.0 International License
panel = Panel(c_script.out)
