# Grasshopper definition CS_07_RTree + PointList neighbour search.gh (Grasshopper 1.0.7)
# Copyright: Co-de-iT

number_slider = Slider(20000, range=10..20000)
mesh = Mesh(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)

# ---- group: random field points
# RTRee search function
random_populate_mesh = CSharpScript(M=mesh, n=number_slider, s="2")  # -> Pts; inputs M: Mesh, V: Mesh, n: Int32, s: Int32
# ---------- random_populate_mesh: C# usings ----------
using System.IO;
using System.Linq;
using System.Data;
using System.Drawing;
using System.Reflection;
using System.Windows.Forms;
using System.Xml;
using System.Xml.Linq;
using System.Runtime.InteropServices;

using Rhino.DocObjects;
using Rhino.Collections;
using GH_IO;
using GH_IO.Serialization;
# ---------- random_populate_mesh: C# ----------
    Random r = new Random(s);
    BoundingBox b = new BoundingBox(M.Vertices.ToPoint3dArray());
    Point3d max = b.Max;
    Point3d min = b.Min;
    double x,y,z;
    int count = 0, i = 0;
    List<Point3d> pts = new List<Point3d>();
    List<Point3d> ptsOut = new List<Point3d>();

    while (count < n){

      x = b.Min.X + r.NextDouble() * (b.Max.X - b.Min.X);
      y = b.Min.Y + r.NextDouble() * (b.Max.Y - b.Min.Y);
      z = b.Min.Z + r.NextDouble() * (b.Max.Z - b.Min.Z);
      Point3d p = new Point3d(x, y, z);

      if (M.IsPointInside(p, 0.1, false) && (V == null ? true : !V.IsPointInside(p, 0.1, false))){
        pts.Add(p);
        count++;
      } else{
        ptsOut.Add(p);
      }

      i++;
    }

    Pts = pts;
# ---------- end random_populate_mesh ----------

# ----
search_points = Slider(500, range=100..1500)
subtraction = Subtraction(A=number_slider, B=search_points)
reduce = RandomReduce(List=random_populate_mesh, Reduction=subtraction, Seed=1)
# CS_07_RTree + PointList neighbour search
# 
# Nearest neighbour points search with RTree and PointList collection - implementation of anonymous function syntax
# 
# code by Alessio Erioli
# 
# v 0.1
# © Co-de-iT 2020 / Creative Commons Attribution-Non Commercial-ShareAlike 4.0 International License
number_slider_2 = Slider(0.35, range=0..10)
use_rtree = BooleanToggle(True)
cloud = CloudDisplay(Points=reduce, Colours=RGB(255, 20, 147), Size="0.05", SpriteType=0)
cloud_2 = CloudDisplay(Points=random_populate_mesh, Colours=ColourSwatch(SwatchColor=RGB(0, 0, 0)), Size="0.02", SpriteType=0)
pt = Point(Point(6.252083726, 7.134620032, 4.174600609))

# ---- group: find neighbours (RTree)
# RTRee is a spatial sorting structure; it dramatically improves results in case of many short-range searches.
# 
# If you try long range searches, the sheer amount of data to process makes it less desirable.
c_script = CSharpScript(P=random_populate_mesh, P0=reduce, radius=number_slider_2, UseRTRee=use_rtree)  # -> out, A, B; inputs P: list of Point3d, P0: list of Point3d, radius: Double, UseRTRee: Boolean
# ---------- c_script: C# ----------
    if (P == null || P.Count == 0) return;

    pts = P;
    cl.Clear();
    ci.Clear();

    if (UseRTRee)
    {

      // declare RTree
      RTree tree = new RTree();

      // populate it
      for(int i = 0; i < P.Count; i++)
        tree.Insert(P[i], i);

      // perform search

      // declare temporary lists for points and indexes
      List < Point3d > closest = new List<Point3d>();
      List <int> closestInd = new List<int>();

      // option 1.1: EventHandler callback function declared on the fly
      //      EventHandler<RTreeEventArgs> rTreeCallback = (object sender, RTreeEventArgs e) =>
      //        {
      //        closest.Add(pts[e.Id]);
      //        closestInd.Add(e.Id);
      //        };

      for (int i = 0; i < P0.Count; i++)
      {
        closest = new List<Point3d>();
        closestInd = new List<int>();

        // option 1.1 & 1.2: call to external function
        // tree.Search(new Sphere(P0[i], radius), rTreeCallback);

        /*
         option 2: use embedded anonymous function with lambda syntax
         the anonymous functions replaces the delegate callback function;
         the delegate parameters and return type aere already known, so no 
         need to specify their type, which are object and RTreeEventArgs respectively
        */
        tree.Search(new Sphere(P0[i], radius), (sender, e) =>
          {
          closest.Add(pts[e.Id]);
          closestInd.Add(e.Id);
          });

        // add lists to data trees
        cl.AddRange(closest, new GH_Path(i));
        ci.AddRange(closestInd, new GH_Path(i));
      }
    }
    else
    {
      for (int i = 0; i < P0.Count; i++)
        for (int j = 0; j < pts.Count; j++)
          if (pts[j].DistanceTo(P0[i]) < radius)
          {
            cl.Add(pts[j], new GH_Path(i));
            ci.Add(j, new GH_Path(i));
          }
    }

    A = cl;
    B = ci;
# ---------- c_script: C# additional code ----------
  DataTree<Point3d> cl = new DataTree<Point3d>();
  DataTree<int> ci = new DataTree<int>();
  List<Point3d> pts = new List<Point3d>();

  // option 1.2: declare callback function as an external one
  //  private void rTreeCallback(object sender, RTreeEventArgs e){
  //  closest.Add(s[e.Id]);
  //  closestInd.Add(e.Id);
  //  }
# ---------- end c_script ----------

# ----
# PointList is a Rhino specific Collection that has the ClosestIndex() method to find index of closest point to another point
c_script_2 = CSharpScript(P0=pt, P=random_populate_mesh)  # -> out, i; inputs P0: Point3d, P: list of Point3d
# ---------- c_script_2: C# usings ----------
using Rhino.Collections;
# ---------- c_script_2: C# ----------
    Point3dList pts = new Point3dList(P);

    i = pts.ClosestIndex(P0);
# ---------- end c_script_2 ----------
item = ListItem(List=random_populate_mesh, Index=c_script_2.i, Wrap=True)
pt_2 = Point(c_script.A)
ln = Line(StartPoint=pt, EndPoint=item)
ln_2 = Line(StartPoint=graft(reduce), EndPoint=pt_2)
preview = CustomPreview(Geometry=ln, Material=ColourSwatch(SwatchColor=RGB(255, 255, 255)))
preview_2 = CustomPreview(
    Geometry=ln_2,
    Material={diffuse=RGB(221, 160, 221), emission=RGB(66, 48, 66), shine=0.5, specular=RGB(255, 255, 255), transparency=0})
