# Grasshopper definition CS_08_using Linq.gh (Grasshopper 1.0.7)
# Copyright: Co-de-iT

# https://www.tutorialsteacher.com/linq/linq-tutorials
# 
# in particular:
# 
# https://www.tutorialsteacher.com/linq/linq-query-syntax
# https://www.tutorialsteacher.com/linq/linq-method-syntax
# https://www.tutorialsteacher.com/linq/linq-lambda-expression
# https://www.tutorialsteacher.com/linq/linq-standard-query-operators
# basic LINQ Query Synthax: from <range variable> in <IEnumerable<T> or IQueryable<T> Collection>
# 
# <Standard Query Operators> <conditional expression>
# 
# <select or groupBy operator> <result formation>
# Query synthax - example in C#: // string collection
# List<string> stringList = new List<string> {
#     "C# Tutorials",
#     "VB.NET Tutorials",
#     "Learn C++",
#     "MVC Tutorials" ,
#     "Java"
# };
# 
# // LINQ Query Syntax
# var result = from s in stringList
#             where s.Contains("Tutorials")
#             select s;
panel = Panel("""C# Tutorials
VB.NET Tutorials
Learn C++
MVC Tutorials
Java""")
# Method synthax - example in C#: // string collection
# List<string> stringList = new List<string> {
#     "C# Tutorials",
#     "VB.NET Tutorials",
#     "Learn C++",
#     "MVC Tutorials" ,
#     "Java"
# };
# 
# // LINQ Query Syntax
# var result = stringList.Where(s => s.Contains("Tutorials"));
# s  =>  s.Contains("Tutorials")
# multiple parameters and multiple statements in lambda expression body: (s, youngAge) =>
# {
#   Console.WriteLine("Lambda expression with multiple statements in the body");
# 
#   Return s.Age >= youngAge;
# }
panel_2 = Panel("""C# Tutorials
VB.NET Tutorials
Learn C++
MVC Tutorials
Java""")
# This is a quick recall, for an in-depth explanation of lambda expression see CS06_CS_06_delegates + lambda expression.gh
panel_3 = Panel("Tutorials")
c_script = CSharpScript(S=panel, f="Tutorials")  # -> out, A; inputs S: list of String, f: String
# ---------- c_script: C# usings ----------
using System.Linq;
# ---------- c_script: C# ----------
    // LINQ Query Syntax
    var result = from s in S
        where s.Contains(f)
        select s;

    A = result;
# ---------- end c_script ----------
c_script_2 = CSharpScript(S=panel_2, f=panel_3)  # -> out, A; inputs S: list of String, f: String
# ---------- c_script_2: C# ----------
    // LINQ Method Syntax
    var result = S.Where(s => s.Contains(f));

    A = result;
# ---------- end c_script_2 ----------
# Multi-Threading
# 
# Multi-Threading, Linq and GH_ types
# 
# © a3 _/TH.esis 2020 _ Creative Commons Attribution-NonCommercial-ShareAlike3.0 UnportedLicense.
# CS_08_using Linq
# 
# Linq syntax for queries - usage examples
# 
# code by Alessio Erioli
# 
# v 0.1
# © Co-de-iT 2020 / Creative Commons Attribution-Non Commercial-ShareAlike 4.0 International License
panel_4 = Panel(c_script.A)
panel_5 = Panel(c_script_2.A)

# ---- group: generate permutations
series = Series(Start=0, Step=1, Count=Slider(4, range=1..4))
crossref = CrossReference(ListA=series, ListB=series, CrossMode=1)  # -> ListA, ListB
concat = Concatenate(FragmentA=crossref.ListB, FragmentB=",", FragmentC=crossref.ListA)  # -> flatten(Result)

# ----
pt = Point(Point(0, 0, 0))
panel_6 = Panel(concat)
# composite example: sorting multiple arrays
vec = VectorXYZ(XComponent=Slider(0.442, range=-1..1), YComponent=Slider(0.935, range=-1..1), ZComponent=Slider(0.874, range=-1..1))  # -> Vector, Length
vdisex = VectorDisplayEx(Point=pt, Vector=vec.Vector, Colour=ColourSwatch(SwatchColor=RGB(255, 255, 255)), Width=2)
# LINQ examples
c_script_3 = CSharpScript(n=Slider(100, range=1..100), S=concat)  # -> out, A, B, C, D, E, F; inputs n: Int32, S: list of String
# ---------- c_script_3: C# ----------
                                                            /*
   System.Linq examples

  the basic lambda synthax is <var> => <anonymous expression with var>

  basic Linq functions:

  Where(<var> => <filtering condition with var>)
  Select(<var> => <expression with var>)
  Sum(<var> => <expression with var>)

   */

    int[] array = new int[n];
    int[] array2 = new int[array.Length];



    List<int> aList = new List<int>();

    // filling the array and list with the index itself
    for(int i = 0; i < array.Length; i++)
    {
      array[i] = i;
      aList.Add(i);
    }

    // filling the array and list with the index itself - the Linq way
    array = array.Select(i => i).ToArray();

    // generating an array of 1s
    array2 = array.Select(i => 1).ToArray();
    //aList = array.Select(i => 1).ToList(); // remember conversions ToArray and ToList

    // . . . . extracting only even numbers

    // extended synthax
    //A = from i in array where(i % 2 == 0) select(i);

    // lambda synthax
    A = array.Where(i => i % 2 == 0);

    // . . . . sum of all numbers
    B = array.Sum(i => i);

    // . . . . sum of all odd numbers
    C = array.Where(i => i % 2 != 0).Sum(i => i);

    // . . . . use in a function
    D = ConvertToGHInt(aList);

    E = ToDataTree(ConvertStringToInt(S));

    F = array.Where(i => i > n*0.5).FirstOrDefault();
# ---------- c_script_3: C# additional code ----------
  public List<GH_Integer> ConvertToGHInt(List<int> list)
  {
    if (list == null) return null;
    else
      return list.Select(c => new GH_Integer(c)).ToList();
  }


  public int[][] ConvertStringToInt(List<String> Sc)
  {
    int[][] selCells = new int[Sc.Count][];

    for (int i = 0; i < Sc.Count; i++)
      selCells[i] = Sc[i].Split(',').Select(sd => Convert.ToInt32(sd)).ToArray();

    return selCells;
  }

  DataTree<GH_Integer> ToDataTree(int[][] array)
  {
    DataTree<GH_Integer> tOut = new DataTree<GH_Integer>();

    for(int i = 0; i < array.Length; i++)
      tOut.AddRange(array[i].Select(k => new GH_Integer(k)), new GH_Path(i));

    return tOut;
  }
# ---------- end c_script_3 ----------
c_script_4 = CSharpScript(V=vec.Vector)  # -> out, VSort, vStar; inputs V: Vector3d
# ---------- c_script_4: C# ----------
    VSort = sortVector(V); // sorted vectors
    vStar = vectorStar; // as a check, to verify that vectorStar is not modified
# ---------- c_script_4: C# additional code ----------
  public static Vector3d[] vectorStar = new Vector3d[]{new Vector3d(-1, 0, 0), new Vector3d(0, -1, 0), new Vector3d(0, 0, -1),
    new Vector3d(1, 0, 0), new Vector3d(0, 1, 0), new Vector3d(0, 0, 1)};

  Vector3d[] sortVector(Vector3d v)
  {

    double[] angles = new double[vectorStar.Length];
    v.Unitize();

    // fill angles array
    angles = vectorStar.Select(x => Vector3d.VectorAngle(v, x)).ToArray(); //using System.Linq;
    //    for(int i = 0; i < vSorted.Length; i++)
    //      angles[i] = Vector3d.VectorAngle(v, vSorted[i]);

    //sorting vectors according to angles
    // taken from: https://stackoverflow.com/questions/29591992/sorting-multiple-arrays-c-sharp
    // if you are wondering what the _ in (_,i) is, check Discards:
    // https://docs.microsoft.com/en-us/dotnet/csharp/discards
    Vector3d[] vSort = (Vector3d[]) vectorStar
      .Select((_, i) => new // this creates a new anonymous class with angles and vectors as fields
      {
        ang = angles[i],
        vec = vectorStar[i]
        })
      .OrderBy(x => x.ang) // sort the anonymous class array by angles
      .Select(x => x.vec) // the new class is an Anonymous type - we need to extract the vectors field only
      .ToArray(); // the result is a generic List class, must be converted to array

    return vSort;
  }
# ---------- end c_script_4 ----------
lng = ListLength(List=c_script_4.VSort)  # -> expr("x-1", Length)
sorted_vectors = Panel(c_script_4.VSort)
vector_star = Panel(c_script_4.vStar)
gh_integer_list = Panel(c_script_3.D)
ilist = IndexesFromList(D=c_script_4.VSort)  # -> i; inputs D: list
# ---------- ilist: C# ----------
    GH_Integer[] indexes = new GH_Integer[D.Count];

    for(int j = 0; j < D.Count; j++)
      indexes[j] = new GH_Integer(j);

    //A = indexes.Sum(j => j.Value); // uses System.Linq Sum selector function - for each GH_Integer j in indexes add its value to the total sum
    
    i = indexes;
# ---------- end ilist ----------
just_even_numbers = Panel(c_script_3.A)
sum_total = Panel(c_script_3.B)
sum_of_odd_numbers = Panel(c_script_3.C)
string_to_datatree_integers = Panel(c_script_3.E)
panel_7 = Panel(c_script_3.F)
division = Division(A=ilist, B=lng)
gradient = Gradient(LowerLimit=0, UpperLimit=1, Parameter=division, stops=[0: RGB(0, 128, 0), 0.5: RGB(255, 255, 0), 1: RGB(255, 0, 0)])
move = Move(Geometry=pt, Motion=c_script_4.VSort)  # -> Geometry, Transform
vdisex_2 = VectorDisplayEx(Point=pt, Vector=c_script_4.VSort, Colour=gradient, Width=2)
points = PointList(Points=move.Geometry, Size=Slider(0.305, range=0..1))
