# Grasshopper definition CS_09_MultiThreading-serialization-GHtypes.gh (Grasshopper 1.0.7)
# Copyright: Co-de-iT
# plug-ins: MeshEdit Components

number_slider = Slider(100, range=5..200)
mt = ValueList({"none": 0, "for": 1, "partitioner": 2}, selected="partitioner")
# Rhinocommon_Type
# GH_Type
ghtype = BooleanToggle(True)
go = BooleanToggle(False)
# Multithreading and GH types
pt = Point(Point(43.29389355, 44.61304929, 10.80206949))
c_script = CSharpScript(
    P0=pt,
    n=number_slider,
    freq=Slider(0.059, range=0..1),
    amp=Slider(5, range=0..10),
    speed=Slider(0.252, range=0..1),
    reset=Button(),
    go=go,
    MT=mt,
    GHtype=ghtype)  # -> out, P; inputs P0: Point3d, n: Int32, freq: Double, amp: Double, speed: Double, reset: Boolean, go: Boolean, MT: Int32, GHtype: Boolean
# ---------- c_script: C# usings ----------
using System.Threading;
using System.Threading.Tasks;
using System.Linq;
# ---------- c_script: C# ----------
    if (reset || ptsArray == null || ptsArray.Length != n * n)
    {
      ptsArray = initPts(n);
      c = 0;
    }

    switch (MT)
    {
      case 0:
        for(int i = 0; i < ptsArray.Length; i++)
        {
          double dd = ptsArray[i].DistanceToSquared(P0);
          ptsArray[i].Z = Math.Cos(dd * ptsArray[i].X * freq * 0.001 + c * speed) * Math.Sin(dd * ptsArray[i].Y * freq * 0.001 + c * speed * 0.43) * amp;
        }
        break;

      case 1:
        Parallel.For(0, ptsArray.Length, i =>
          {
          double dd = ptsArray[i].DistanceToSquared(P0);
          ptsArray[i].Z = Math.Cos(dd * ptsArray[i].X * freq * 0.001 + c * speed) * Math.Sin(dd * ptsArray[i].Y * freq * 0.001 + c * speed * 0.43) * amp;
          });
        break;

      //      case 2:
      // Parallel.Foreach does not work with arrays (list only?)
      //        Parallel.ForEach(ptsArray, pt =>
      //          {
      //          double dd = pt.DistanceToSquared(P0);
      //          pt.Z = Math.Cos(dd * pt.X * freq * 0.001 + c * speed) * Math.Sin(dd * pt.Y * freq * 0.001 + c * speed * 0.43) * amp;
      //          });
      //        break;

      case 2:
        var  chunks = System.Collections.Concurrent.Partitioner.Create(0, ptsArray.Length);
        Parallel.ForEach(chunks, range =>
          {
          for(int i = range.Item1; i < range.Item2; i++)
          {
            double dd = ptsArray[i].DistanceToSquared(P0);
            ptsArray[i].Z = Math.Cos(dd * ptsArray[i].X * freq * 0.001 + c * speed) * Math.Sin(dd * ptsArray[i].Y * freq * 0.001 + c * speed * 0.43) * amp;
          }
          });
        break;
    }

    if (go)
    {
      c++;
      Component.ExpireSolution(true);
    }

    if(GHtype)
      P = ptsArray.Select(x => new GH_Point(x));
    else P = ptsArray;
# ---------- c_script: C# additional code ----------
  Point3d[] ptsArray;
  int c;

  Point3d[] initPts(int n)
  {
    Point3d[] ptsArray = new Point3d[n * n];

    for(int i = 0; i < n; i++)
      for(int j = 0; j < n; j++)
        ptsArray[i * n + j] = new Point3d(i, j, 0);
    return ptsArray;
  }
# ---------- end c_script ----------
number_slider_2 = Slider(2, range=1..5)
frompoints = MeshFromPoints(Points=c_script.P, UDirection=number_slider, VDirection=number_slider)
# CS_09_MultiThreading-serialization-GHtypes
# 
# Multi-Threading, serialization and GH_ types
# 
# code by Alessio Erioli
# 
# v 0.1
# © Co-de-iT 2020 / Creative Commons Attribution-Non Commercial-ShareAlike 4.0 International License
preview = CustomPreview(Geometry=pt, Material=ColourSwatch(SwatchColor=RGB(0, 0, 0)))
# GH_Type
# Rhinocommon_Type
# Serialization/Deserialization: GH has its own data formats, mainly for transmission and display purposes. They work as "wrapper" classes around Rhinocommon classes.
# 
# Inside a component, data must be cast form GH_Type to a proper Rhinocommon type, and at the end of the algortim, the Rhinocommon data in output must be cast back into appropriate GH_Types.
# 
# This process might take up a lot of computing time as the number of elements to convert increases.
# 
# To cut this time off, there are two helpful strategies:
# 
# . in input: keep the data type to object or System.Object and perform the casting inside the component
# . in output: try to output as much as possible GH_Types directly
number_slider_3 = Slider(0.79, range=0..1)
mcol = MeshColours(Mesh=frompoints, Colours=ColourSwatch(SwatchColor=RGB(255, 255, 255)))
# Property
# Field
# Method()
# Constructor()
# ...
swatch = ColourSwatch(SwatchColor=RGB(71, 103, 107))
X = UnitX(Factor=1)

# ---- group: display pointcloud
# < input as Point3d
c_script_2 = CSharpScript(P=c_script.P, W=number_slider_2)  # inputs P: list of Point3d, W: Int32; disabled
# ---------- c_script_2: C# usings ----------
using System.Drawing;
# ---------- c_script_2: C# ----------
    // points are imported here as System.Object
    _cloud = new PointCloud();
    _width = W;

    for(int i = 0; i < P.Count; i++)
      _cloud.Add(P[i]);

    _clip = _cloud.GetBoundingBox(false);
# ---------- c_script_2: C# additional code ----------
  private PointCloud _cloud;
  private BoundingBox _clip;
  private int _width;

  //Return a BoundingBox that contains all the geometry you are about to draw.
  public override BoundingBox ClippingBox
  {
    get
    {
      return _clip;
    }
  }

  //Draw all wires and points in this method.
  public override void DrawViewportWires(IGH_PreviewArgs args)
  {
    if (_cloud == null)
      return;

    args.Display.DrawPointCloud(_cloud, _width);
  }
# ---------- end c_script_2 ----------
# < input as System.Object
c_script_3 = CSharpScript(P=c_script.P, W=number_slider_2)  # inputs P: list, W: Int32; disabled
# ---------- c_script_3: C# ----------
// points are imported here as System.Object
    _cloud = new PointCloud();
    _width = W;

    for(int i = 0; i < P.Count; i++)
      _cloud.Add((Point3d) P[i]);

    _clip = _cloud.GetBoundingBox(false);
# ---------- c_script_3: C# additional code ----------
  private PointCloud _cloud;
  private BoundingBox _clip;
  private int _width;

  //Return a BoundingBox that contains all the geometry you are about to draw.
  public override BoundingBox ClippingBox
  {
    get
    {
      return _clip;
    }
  }

  //Draw all wires and points in this method.
  public override void DrawViewportWires(IGH_PreviewArgs args)
  {
    if (_cloud == null)
      return;

    args.Display.DrawPointCloud(_cloud, _width);
  }
# ---------- end c_script_3 ----------

# ---- group: Normal Shader
# Rhinocommon_Type
# Rhinocommon_Type
# GH_Type
# GH_Type
c_script_4 = CSharpScript(mesh=mcol, direction=X, color=swatch, intensity=number_slider_3)  # -> out, result; inputs mesh: Mesh, direction: Vector3d, color: Color, intensity: Double
# ---------- c_script_4: C# usings ----------
using System.IO;
using System.Linq;
using System.Data;
using System.Drawing;
using System.Reflection;
using System.Windows.Forms;
using System.Xml;
using System.Xml.Linq;
using System.Runtime.InteropServices;

using Rhino.DocObjects;
using Rhino.Collections;
using GH_IO;
using GH_IO.Serialization;
# ---------- c_script_4: C# ----------
    if(mesh.Normals.Count != mesh.Vertices.Count)
      mesh.Normals.ComputeNormals();

    if(mesh.VertexColors.Count != mesh.Vertices.Count)
      mesh.VertexColors.CreateMonotoneMesh(Color.White);

    NormalShader(mesh, direction, color, intensity);
    result = mesh;
# ---------- c_script_4: C# additional code ----------
  //
  void NormalShader(Mesh mesh, Vector3d direction, Color color, double intensity)
  {
    if(!direction.Unitize())
      throw new System.ArgumentException("the direction vector cannot be zero length");

    Color[] vc = mesh.VertexColors.ToArray();

    var chunks = System.Collections.Concurrent.Partitioner.Create(0, mesh.Vertices.Count);
    System.Threading.Tasks.Parallel.ForEach(chunks, range =>
      {
      for (int i = range.Item1; i < range.Item2; i++)
      {
        double t = direction * mesh.Normals[i] * 0.5 + 0.5;
        vc[i] = Color.FromArgb((int) (vc[i].R * (1 - (t * intensity)) + color.R * (t * intensity)),
          (int) (vc[i].G * (1 - (t * intensity)) + color.G * (t * intensity)),
          (int) (vc[i].B * (1 - (t * intensity)) + color.B * (t * intensity)));
      }
      });

    mesh.VertexColors.SetColors(vc);
  }
# ---------- end c_script_4 ----------
