# Grasshopper definition CS_10_MultiThreading-Diffusion.gh (Grasshopper 1.0.7)
# Copyright: Co-de-iT

wrap = BooleanToggle(False)
reset = Button()
go = BooleanToggle(False)
mt = BooleanToggle(True)
pt = Point(Point(43.55851908, 21.48869063, 2.244653487))
pt_2 = Point(Point(10.67510702, 35.22179734, 2.244653487))
merge = Merge(Data1=pt, Data2=pt_2)
merge_2 = Merge(Data1=Slider(0.582, range=0..1), Data2=Slider(0.25, range=0..1))
amp = Slider(5, range=1..10)
c_script = CSharpScript(
    P0=merge,
    strength=merge_2,
    n=Slider(50, range=5..200),
    evap=Slider(0.993, range=0..1),
    addC=Slider(0.396, range=0..1),
    lossC=Slider(0.379, range=0..1),
    wrap=wrap,
    reset=reset,
    go=go,
    MT=mt)  # -> out, P, cPind, nIndexes, S; inputs P0: list of Point3d, strength: list of Double, n: Int32, evap: Double, addC: Double, lossC: Double, wrap: Boolean, reset: Boolean, go: Boolean, MT: Boolean
# ---------- c_script: C# usings ----------
using System.Threading.Tasks;
using Rhino.Collections;
using System.Linq;
# ---------- c_script: C# ----------
    // reset/initialize

    if (reset || diff == null || diff.ptsArray.Length != n * n)
    {

      diff = new Diffusion(n, n, wrap);
      ptsList = new Point3dList(diff.ptsArray); // create a Point3dList for faster closest point calculation
      cP = new List<int>();
      int pInd;
      foreach(Point3d p in P0)
      {
        pInd = ptsList.ClosestIndex(p);
        cP.Add(pInd); // find index of closest point to attractor
        diff.stigVal[pInd] = 1;
      }
      c = 0; // reset counter
    }

    if (go)
    {
      diff.evap = evap;
      diff.addCoeff = addC;
      diff.lossCoeff = lossC;

      if(MT) diff.UpdateMT(); else diff.Update();
      for (int i = 0; i < cP.Count; i++) diff.stigVal[cP[i]] += strength[i];
      c++;
      Component.ExpireSolution(true);
    }

    P = diff.ptsArray.Select(x => new GH_Point(x)).ToArray();
    S = diff.stigVal.Select(x => new GH_Number(x)).ToArray();
    cPind = cP;
    // nIndexes = diff.GetNeighIndexes();
# ---------- c_script: C# additional code ----------
  Diffusion diff;
  Point3dList ptsList;
  int c;
  List<int> cP;

  // array of diffusion coefficients (in CCW order - 4 principal directions first, then corners)
  public static double[] dC = {0.2, 0.2, 0.2, 0.2, 0.05, 0.05, 0.05, 0.05};


  public class Diffusion
  {
    public Point3d[] ptsArray;
    public int[][] nInd;
    public double[][] nDiff;
    public int x;
    public int y;
    public double evap;
    public double addCoeff;
    public double lossCoeff;
    public bool wrap;
    public double[] stigVal;
    public double[] dC = {0.2, 0.2, 0.2, 0.2, 0.05, 0.05, 0.05, 0.05};
    Random rnd;

    public Diffusion(int x, int y, bool wrap)
    {
      rnd = new Random();
      this.x = x;
      this.y = y;
      this.wrap = wrap;

      initPts();
      initStig();
      BuildNeighInd();
    }

    public void UpdateMT()
    {
      double[] stigMod = new double[stigVal.Length];
      double[] stigLoss = new double[stigVal.Length];

      // instead of calculating an outgoing value (writing to neighbours)
      // an incoming contribution from neighbours is calculated (reading from neighbours)
      // hence making parallel computation possible
      Parallel.For(0, stigVal.Length, i =>
        {
        for(int j = 0; j < nInd[i].Length; j++)
        {
          stigMod[i] += stigVal[nInd[i][j]] * nDiff[i][j];
          stigLoss[i] += stigVal[i] * nDiff[i][j];
        }
        });

      // still, calculation must be split in 2 parts: calculating modification and value update
      Parallel.For(0, stigVal.Length, i =>
        {
        stigVal[i] = (stigVal[i] + stigMod[i] * addCoeff - stigLoss[i] * lossCoeff) * Math.Pow(evap, 2);
        //        stigVal[i] += stigMod[i];
        //        stigVal[i] *= evap;
        //if (stigVal[i] > 1) stigVal[i] = 1;
        stigVal[i] = Math.Min(stigVal[i], 1);
        });


    }

    public void Update()
    {
      double[] stigMod = new double[stigVal.Length];
      double[] stigLoss = new double[stigVal.Length];

      // instead of calculating an outgoing value (writing to neighbours)
      // an incoming contribution from neighbours is calculated (reading from neighbours)
      // hence making parallel computation possible
      for(int i = 0; i < stigVal.Length; i++)
      {
        for(int j = 0; j < nInd[i].Length; j++)
        {
          stigMod[i] += stigVal[nInd[i][j]] * nDiff[i][j];
          stigLoss[i] += stigVal[i] * nDiff[i][j];
        }
      }

      // still, calculation must be split in 2 parts: calculating modification and value update
      for(int i = 0; i < stigVal.Length; i++)
      {
        stigVal[i] = (stigVal[i] + stigMod[i] * addCoeff - stigLoss[i] * lossCoeff) * evap;
        //        stigVal[i] += stigMod[i];
        //        stigVal[i] *= evap;
        //if (stigVal[i] > 1) stigVal[i] = 1;
        stigVal[i] = Math.Min(stigVal[i], 1);
      }


    }

    //    public void UpdateOld()
    //    {
    //      double[] stigMod = new double[stigVal.Length];
    //
    //      for(int i = 0; i < stigVal.Length; i++)
    //        for(int j = 0; j < nInd[i].Length; j++)
    //          stigMod[nInd[i][j]] += stigVal[i] * dC[j] * 1;
    //
    //      Parallel.For(0, stigVal.Length, i =>
    //        //for(int i = 0; i < stigVal.Length; i++)
    //        {
    //        stigVal[i] += stigMod[i];
    //        stigVal[i] *= evap;
    //        //if (stigVal[i] > 1) stigVal[i] = 1;
    //        stigVal[i] = Math.Min(stigVal[i], 1);
    //
    //        });
    //    }

    void initPts()
    {
      ptsArray = new Point3d[x * y];

      for(int i = 0; i < x; i++)
        for(int j = 0; j < y; j++)
          ptsArray[i * y + j] = new Point3d(i, j, 0);
    }

    void initStig()
    {
      stigVal = new double[x * y];

      for(int i = 0; i < x; i++)
        for(int j = 0; j < y; j++)
          stigVal[i * y + j] = 0.0;//rnd.NextDouble() * 0.2;// 0.0;
    }

            /*
 neighbour indexes schematic:

         5   1   4
           \ | /
         2 - i - 0
  Y+       / | \
  |      6   3   7
  o - X+

  */

    void BuildNeighInd()
    {
      nInd = new int[x * y][];
      nDiff = new double[x * y][];
      for (int i = 0; i < x * y; i++)
      {
        int ix, iy, ixp, iyp, ixm, iym;
        bool r, u, l, d;
        ix = (int) Math.Floor(i / (double) y);
        iy = i % y;

        ixp = ix + 1;
        ixm = ix - 1;
        iyp = iy + 1;
        iym = iy - 1;

        r = ixp < x;
        u = iyp < y;
        l = ixm >= 0;
        d = iym >= 0;

        List<int> nL = new List<int>();
        List<double> nD = new List<double>();
        // compute neighbour indexes

        if (r || wrap)
        {
          nL.Add((ixp % x) * y + iy);// x+
          nD.Add(dC[0]);
        }
        if (u || wrap)
        {
          nL.Add(ix * y + (iyp % y));// y+
          nD.Add(dC[1]);
        }
        if (l || wrap)
        {
          nL.Add(((ixm + x) % x) * y + iy);// x-
          nD.Add(dC[2]);
        }
        if (d || wrap)
        {
          nL.Add(ix * y + ((iym + y) % y));// y-
          nD.Add(dC[3]);
        }
        if ((r && u) || wrap)
        {
          nL.Add((ixp % x) * y + (iyp % y));// x+ y+
          nD.Add(dC[4]);
        }
        if ((l && u) || wrap)
        {
          nL.Add(((ixm + x) % x) * y + (iyp % y));// x- y+
          nD.Add(dC[5]);
        }
        if ((l && d) || wrap)
        {
          nL.Add(((ixm + x) % x) * y + ((iym + y) % y));// x- y-
          nD.Add(dC[6]);
        }
        if ((r && d) || wrap)
        {
          nL.Add((ixp % x) * y + ((iym + y) % y));// x+ y-
          nD.Add(dC[7]);
        }
        nInd[i] = nL.ToArray();
        nDiff[i] = nD.ToArray();
      }
    }

    public DataTree<GH_Integer> GetNeighIndexes()
    {
      return ToDataTree(nInd);
    }

    DataTree<GH_Integer> ToDataTree(int[][] vals)
    {
      DataTree<GH_Integer> vTree = new DataTree<GH_Integer>();

      for(int i = 0; i < vals.Length; i++)
        vTree.AddRange(vals[i].Select(x => new GH_Integer(x)), new GH_Path(i));
      return vTree;
    }

  }
# ---------- end c_script ----------

# ---- group: get neighbour indexes in a point matrix / matrix in xRow order
c_script_2 = CSharpScript()  # -> out, P, nInd; inputs x: Int32, y: Int32, ind: Int32, wrap: Boolean; disabled
# ---------- c_script_2: C# ----------
    ptsArray = initPts(x, y);
    P = ptsArray;
    nInd = neighInd(ind, x, y, wrap);
# ---------- c_script_2: C# additional code ----------
  Point3d[] ptsArray;
  //int[][] nInd;

  // in matrix indexes, y are rows and x columns indexes
  Point3d[] initPts(int x, int y)
  {
    Point3d[] ptsArray = new Point3d[x * y];

    for(int i = 0; i < y; i++)
      for(int j = 0; j < x; j++)
        ptsArray[i * x + j] = new Point3d(j, i, 0);
    return ptsArray;
  }

  int[] neighInd(int i, int x, int y, bool wrap)
  {

        /*
 neighbour indexes schematic:

         5   1   4
           \ | /
         2 - i - 0
  Y+       / | \
  |      6   3   7
  o - X+

  */

    int[] nI = new int[8];
    int ix, iy, ixp, iyp, ixm, iym;
    iy = (int) Math.Floor(i / (double) x);
    ix = i % x;

    ixp = ix + 1;
    ixm = ix - 1;
    iyp = iy + 1;
    iym = iy - 1;

    // compute neighbour indexes
    // (in CCW order - 4 principal directions first, then corners)
    nI[0] = iy * x + (ixp % x);
    nI[1] = (iyp % y) * x + ix;
    nI[2] = iy * x + ((ixm + x) % x);
    nI[3] = ((iym + y) % y) * x + ix;
    nI[4] = (iyp % y) * x + (ixp % x);
    nI[5] = (iyp % y) * x + ((ixm + x) % x);
    nI[6] = ((iym + y) % y) * x + ((ixm + x) % x);
    nI[7] = ((iym + y) % y) * x + (ixp % x);

    if(!wrap)
    {
      // boundary check x

      if(ixp == x)
      {
        nI[0] = -1;
        nI[4] = -1;
        nI[7] = -1;
      } else if (ixm < 0)
      {
        nI[2] = -1;
        nI[5] = -1;
        nI[6] = -1;
      }

      // boundary check y
      if (iyp == y)
      {
        nI[5] = -1;
        nI[1] = -1;
        nI[4] = -1;
      } else if(iym < 0)
      {
        nI[6] = -1;
        nI[3] = -1;
        nI[7] = -1;
      }
    }

    return nI;
  }
# ---------- end c_script_2 ----------

# ----
multiplication = Multiplication(A=c_script.S, B=amp)
Z = UnitZ(Factor=multiplication)
gradient = Gradient(
    LowerLimit=0,
    UpperLimit=1,
    Parameter=c_script.S,
    stops=[0.221: RGB(0, 0, 0), 0.498: RGB(56, 136, 150), 0.777: RGB(255, 255, 255)])
# CS_10_MultiThreading-Diffusion
# 
# Multi-threading and diffusion algorithm on a 2D matrix
# 
# code by Alessio Erioli
# 
# v 0.1
# © Co-de-iT 2020 / Creative Commons Attribution-Non Commercial-ShareAlike 4.0 International License
item = ListItem(List=c_script.P, Index=c_script.cPind, Wrap=True)
move = Move(Geometry=c_script.P, Motion=Z)  # -> Geometry, Transform
preview = CustomPreview(Geometry=item, Material=ColourSwatch(SwatchColor=RGB(0, 0, 0)))

# ---- group: display pointcloud
c_script_3 = CSharpScript(P=move.Geometry, C=gradient, W=Slider(3, range=1..5))  # inputs P: list, C: list, W: Int32
# ---------- c_script_3: C# usings ----------
using System.Drawing;
# ---------- c_script_3: C# ----------
    _cloud = new PointCloud();
    _width = W;

    for(int i = 0; i < P.Count; i++)
      _cloud.Add((Point3d) P[i], (Color) C[i]);
    
    _clip = _cloud.GetBoundingBox(false);
# ---------- c_script_3: C# additional code ----------
  private PointCloud _cloud;
  private BoundingBox _clip;
  private int _width;

  //Return a BoundingBox that contains all the geometry you are about to draw.
  public override BoundingBox ClippingBox
  {
    get
    {
      return _clip;
    }
  }

  //Draw all wires and points in this method.
  public override void DrawViewportWires(IGH_PreviewArgs args)
  {
    if (_cloud == null)
      return;

    args.Display.DrawPointCloud(_cloud, _width);
  }
# ---------- end c_script_3 ----------

# ---- group: get neighbour indexes in a point matrix
number_slider = Slider(6, range=1..20)
number_slider_2 = Slider(9, range=1..20)
number_slider_3 = Slider(0.133, range=0..1)
wrap_2 = BooleanToggle(True)

# ----
expression = Expression(x=number_slider_2, y=number_slider, z=number_slider_3, Expression="round((x*y-1)*z)")

# ---- group: get neighbour indexes in a point matrix / matrix in yRow order (same as GH point grid)
c_script_4 = CSharpScript(x=number_slider_2, y=number_slider, ind=expression, wrap=wrap_2)  # -> out, P, nInd; inputs x: Int32, y: Int32, ind: Int32, wrap: Boolean
# ---------- c_script_4: C# ----------
    ptsArray = initPts(x, y);
    P = ptsArray;
    nInd = neighInd(ind, x, y, wrap);
# ---------- c_script_4: C# additional code ----------
  Point3d[] ptsArray;
  //int[][] nInd;

  // in matrix indexes, y are rows and x columns indexes
  Point3d[] initPts(int x, int y)
  {
    Point3d[] ptsArray = new Point3d[x * y];

    for(int i = 0; i < x; i++)
      for(int j = 0; j < y; j++)
        ptsArray[i * y + j] = new Point3d(i, j, 0);
    return ptsArray;
  }

  int[] neighInd(int i, int x, int y, bool wrap)
  {

        /*
 neighbour indexes schematic:

         5   1   4
           \ | /
         2 - i - 0
  Y+       / | \
  |      6   3   7
  o - X+

  */

    int[] nI = new int[8];
    int ix, iy, ixp, iyp, ixm, iym;
    ix = (int) Math.Floor(i / (double) y);
    iy = i % y;

    ixp = ix + 1;
    ixm = ix - 1;
    iyp = iy + 1;
    iym = iy - 1;

    // compute neighbour indexes
    // (in CCW order - 4 principal directions first, then corners)
    nI[0] = (ixp % x) * y + iy;
    nI[1] = ix * y + (iyp % y);
    nI[2] = ((ixm + x) % x) * y + iy;
    nI[3] = ix * y + ((iym + y) % y);
    nI[4] = (ixp % x) * y + (iyp % y);
    nI[5] = ((ixm + x) % x) * y + (iyp % y);
    nI[6] = ((ixm + x) % x) * y + ((iym + y) % y);
    nI[7] = (ixp % x) * y + ((iym + y) % y);

    if(!wrap)
    {
      // boundary check x

      if(ixp == x)
      {
        nI[0] = -1;
        nI[4] = -1;
        nI[7] = -1;
      } else if (ixm < 0)
      {
        nI[2] = -1;
        nI[5] = -1;
        nI[6] = -1;
      }

      // boundary check y
      if (iyp == y)
      {
        nI[5] = -1;
        nI[1] = -1;
        nI[4] = -1;
      } else if(iym < 0)
      {
        nI[6] = -1;
        nI[3] = -1;
        nI[7] = -1;
      }
    }

    return nI;
  }
# ---------- end c_script_4 ----------

# ---- group: get neighbour indexes in a point matrix (continued)
panel = Panel(expression)
neighbours_indexes = Panel(c_script_4.nInd)

# ---- group: get neighbour indexes in a point matrix / display neighbours
item_2 = ListItem(List=c_script_4.P, Index=c_script_4.nInd, Wrap=False)
preview_2 = CustomPreview(Geometry=item_2, Material=ColourSwatch(SwatchColor=RGB(0, 0, 0)))

# ---- group: get neighbour indexes in a point matrix / display point in grid
item_3 = ListItem(List=c_script_4.P, Index=expression, Wrap=True)
preview_3 = CustomPreview(
    Geometry=item_3,
    Material={diffuse=RGB(221, 160, 221), emission=RGB(66, 48, 66), shine=0.5, specular=RGB(255, 255, 255), transparency=0})

# ---- group: get neighbour indexes in a point matrix / grid points indexes
points = PointList(Points=c_script_4.P, Size="0.25")
